# Grasshopper definition Robots_EGL_Commands_241216.gh (Grasshopper 1.0.8)
# plug-ins: RhinoCodePluginGH, Robots, RobotsExtended

# ---- group: Move To
egl_moveto = CSharpScript(Position=Slider(85, range=0..85))  # -> out, Command; inputs Position: Double
# ---------- egl_moveto: C# ----------
// Grasshopper Script Instance
#region Usings
using System;
using System.Linq;
using System.Collections;
using System.Collections.Generic;
using System.Drawing;

using Rhino;
using Rhino.Geometry;

#r "nuget: Robots, 1.8.0"
using Robots;
using Robots.Commands;

using Grasshopper;
using Grasshopper.Kernel;
using Grasshopper.Kernel.Data;
using Grasshopper.Kernel.Types;
#endregion

public class Script_Instance : GH_ScriptInstance
{
    #region Notes
    /* 
      Members:
        RhinoDoc RhinoDocument
        GH_Document GrasshopperDocument
        IGH_Component Component
        int Iteration

      Methods (Virtual & overridable):
        Print(string text)
        Print(string format, params object[] args)
        Reflect(object obj)
        Reflect(object obj, string method_name)
    */
    #endregion

    private void RunScript(double _Position, ref object Command_)
    {        
        var manufacturer = Manufacturers.KUKA;
        Command_ = new Robots.Commands.Custom(
            "EGL_MoveTo",
            manufacturer,
            $"EGL_IS_OK = EGL_MoveTo({_Position})", 
            null);;
    }
}
# ---------- end egl_moveto ----------
panel = Panel(egl_moveto.Command)
egl_moveto_2 = CommandParameter(egl_moveto.Command)

# ---- group: Set Properties
egl_set = CSharpScript(
    Position=Slider(85, range=0..85),
    Speed=Slider(150, range=0..150),
    Acceleration=Slider(2500, range=0..2500),
    Jerk=Slider(500000, range=0..500000),
    Amperage=Slider(4, range=0..4))  # -> out, Command; inputs Position: Double, Speed: Double, Acceleration: Double, Jerk: Double, Amperage: Double
# ---------- egl_set: C# ----------
// Grasshopper Script Instance
#region Usings
using System;
using System.Linq;
using System.Collections;
using System.Collections.Generic;
using System.Drawing;

using Rhino;
using Rhino.Geometry;

#r "nuget: Robots, 1.8.0"
using Robots;
using Robots.Commands;

using Grasshopper;
using Grasshopper.Kernel;
using Grasshopper.Kernel.Data;
using Grasshopper.Kernel.Types;
#endregion

public class Script_Instance : GH_ScriptInstance
{
    #region Notes
    /* 
      Members:
        RhinoDoc RhinoDocument
        GH_Document GrasshopperDocument
        IGH_Component Component
        int Iteration

      Methods (Virtual & overridable):
        Print(string text)
        Print(string format, params object[] args)
        Reflect(object obj)
        Reflect(object obj, string method_name)
    */
    #endregion

    private void RunScript(
	double _Position,
	double _Speed,
	double _Acceleration,
	double _Jerk,
	double _Amperage,
	ref object Command_)
    {        
        var manufacturer = Manufacturers.KUKA;
        var commands = new List<Command>();

        if(_Position > 0 )
        commands.Add(
            new Robots.Commands.Custom(
                "EGL_Set_Position",
                manufacturer,
                $"EGL_SetPosition({_Position})", 
                null));

        if(_Speed > 0 )
        commands.Add(
            new Robots.Commands.Custom(
                "EGL_Set_Speed",
                manufacturer,
                $"EGL_SetSpeed({_Speed})", 
                null));

        if(_Acceleration > 0 )
        commands.Add(
            new Robots.Commands.Custom(
                "EGL_Set_Acceleration",
                manufacturer,
                $"EGL_SetAcceleration({_Acceleration})", 
                null));

        if(_Jerk > 0 )
        commands.Add(
            new Robots.Commands.Custom(
                "EGL_Set_Jerk",
                manufacturer,
                $"EGL_SetJerk({_Jerk})", 
                null));

        if(_Amperage > 0 )
        commands.Add(
            new Robots.Commands.Custom(
                "EGL_Set_Amperage",
                manufacturer,
                $"EGL_SetAmperage({_Amperage})", 
                null));

        var cmdGroup = new Group(commands);
        Command_ = cmdGroup;
    }
}
# ---------- end egl_set ----------
panel_2 = Panel(egl_set.Command)
egl_settings = CommandParameter(egl_set.Command)

# ---- group: Gripper Settings
# RH7 + RH8 compatible
# If you encounter an error message telling you that it could not find assembly "Robots.dll" - you have to re-reference it:
# 
# Depending on how you installed Robots you can find the .dll:
# PackageManager:
# C:\Users\[YOUR USERNAME]\AppData\Roaming\McNeel\Rhinoceros\packages\8.0\Robots\1.8.0
# 
# Food4Rhino:
# C:\Users\[YOUR USERNAME]\AppData\Roaming\Grasshopper\Libraries
# 
# 
# Re-reference either using the dialog when you open this document, or Right-Click on the scripting component and selecting "Manage Assemblies" then Add.
number_slider = Slider(85, range=0..85)
egl_settings_2 = CSharpScript(
    Position=number_slider,
    Speed=Slider(150, range=0..150),
    Acceleration=Slider(2500, range=0..2500),
    Jerk=Slider(500000, range=0..500000),
    Amperage=Slider(4, range=0..4),
    Reference="C:\USERS\G.LOBE.ITI-NETZ\APPDATA\ROAMING\MCNEEL\RHINOCEROS\PACKAGES\8.0\ROBOTS\1.8.0\Robots.dll")  # -> out, Command; inputs Position: Double, Speed: Double, Acceleration: Double, Jerk: Double, Amperage: Double
# ---------- egl_settings_2: C# usings ----------
using Robots;
using Robots.Commands;
# ---------- egl_settings_2: C# ----------
    var manufacturer = Manufacturers.KUKA;
    var commands = new List<Command>();

    if(_Position > 0 )
      commands.Add(
        new Robots.Commands.Custom(
        string.Format("EGL_Set_Position_"+(int)_Position),
        manufacturer,
        string.Format("EGL_SetPosition("+_Position+")"),
        null));

    if(_Speed > 0 )
      commands.Add(
        new Robots.Commands.Custom(
        string.Format("EGL_Set_Speed_"+(int)_Speed),
        manufacturer,
        string.Format("EGL_SetSpeed("+ _Speed +")"),
        null));

    if(_Acceleration > 0 )
      commands.Add(
        new Robots.Commands.Custom(
        string.Format("EGL_Set_Acceleration_"+(int)_Acceleration),
        manufacturer,
       string.Format("EGL_SetAcceleration("+_Acceleration+")"),
        null));

    if(_Jerk > 0 )
      commands.Add(
        new Robots.Commands.Custom(
        string.Format("EGL_Set_Jerk_"+(int)_Jerk),
        manufacturer,
        string.Format("EGL_SetJerk("+_Jerk+")"),
        null));

    if(_Amperage > 0 )
      commands.Add(
        new Robots.Commands.Custom(
        string.Format("EGL_Set_Amperage_"+(int)_Amperage),
        manufacturer,
        string.Format("EGL_SetAmperage("+_Amperage+")"),
        null));

    var cmdGroup = new Group(commands);
    Command_ = cmdGroup;
# ---------- end egl_settings_2 ----------
panel_3 = Panel(egl_settings_2.Command)
group_command = GroupCommand(Commands=egl_settings_2.Command)
egl_settings_3 = CommandParameter(egl_settings_2.Command)

# ---- group: Move Gripper
# move the 2 brackets of the gripper to a position
# (0 = closed; 85 = fully open)
number_slider_2 = Slider(85, range=0..85)
egl_moveto_3 = CSharpScript(
    Position=number_slider_2,
    Reference="C:\Users\g.lobe.ITI-NETZ\AppData\Roaming\McNeel\Rhinoceros\packages\8.0\Robots\1.8.0\Robots.dll")  # -> out, Command; inputs Position: Double
# ---------- egl_moveto_3: C# ----------
    var manufacturer = Manufacturers.KUKA;
    Command_ = new Robots.Commands.Custom(
      string.Format("EGL_MoveTo_"+(int)_Position),
      manufacturer,
      string.Format("EGL_IS_OK = EGL_MoveTo("+(int)_Position+")"),
      null);;
# ---------- end egl_moveto_3 ----------
panel_4 = Panel(egl_moveto_3.Command)

# ----
number_slider_3 = Slider(0, range=0..85)

# ---- group: On Programm Start
# RH8 compatible
egl_init = CSharpScript()  # -> out, Command
# ---------- egl_init: C# ----------
// Grasshopper Script Instance
#region Usings
using System;
using System.Linq;
using System.Collections;
using System.Collections.Generic;
using System.Drawing;

using Rhino;
using Rhino.Geometry;

#r "nuget: Robots, 1.8.0"
using Robots;
using Robots.Commands;

using Grasshopper;
using Grasshopper.Kernel;
using Grasshopper.Kernel.Data;
using Grasshopper.Kernel.Types;
#endregion

public class Script_Instance : GH_ScriptInstance
{
    #region Notes
    /* 
      Members:
        RhinoDoc RhinoDocument
        GH_Document GrasshopperDocument
        IGH_Component Component
        int Iteration

      Methods (Virtual & overridable):
        Print(string text)
        Print(string format, params object[] args)
        Reflect(object obj)
        Reflect(object obj, string method_name)
    */
    #endregion

    private void RunScript(ref object Command_)
    {
        var manufacturer = Manufacturers.KUKA;
        var commands = new List<Command>()
        {
            new Robots.Commands.Custom(
                "EGL_Reset",
                manufacturer,
                "EGL_Reset()", 
                null),
                
            new Robots.Commands.Custom(
                "EGL_Init",
                manufacturer,
                "EGL_Init()", 
                null),
        };

        var cmdGroup = new Group(commands);
        Command_ = cmdGroup;
    }
}
# ---------- end egl_init ----------
panel_5 = Panel(egl_init.Command)
egl_init_2 = CommandParameter(egl_init.Command)

# ---- group: Initialize Gripper
# always place on top of your program
# -> "Init commands" - Input of "Create Program"-component
egl_init_3 = CSharpScript(Reference="C:\USERS\G.LOBE.ITI-NETZ\APPDATA\ROAMING\MCNEEL\RHINOCEROS\PACKAGES\8.0\ROBOTS\1.8.0\Robots.dll")  # -> out, Command
# ---------- egl_init_3: C# ----------
        var manufacturer = Manufacturers.KUKA;
        var commands = new List<Command>()
        {
            new Robots.Commands.Custom(
                "EGL_Reset",
                manufacturer,
                "EGL_Reset()", 
                null),
                
            new Robots.Commands.Custom(
                "EGL_Init",
                manufacturer,
                "EGL_Init()", 
                null),
        };

        var cmdGroup = new Group(commands);
        Command_ = cmdGroup;
# ---------- end egl_init_3 ----------
panel_6 = Panel(egl_init_3.Command)
group_command_2 = GroupCommand(Commands=egl_init_3.Command)
egl_init_4 = CommandParameter(egl_init_3.Command)

# ----
group_command_3 = GroupCommand(Commands=egl_init_2)
group_command_4 = GroupCommand(Commands=egl_settings)
egl_moveto_4 = CommandParameter(egl_moveto_3.Command)

# ---- group: Move To
egl_moveto_5 = CSharpScript(Position=graft([Slider(0, range=0..85), Slider(85, range=0..85)]))  # -> out, Command; inputs Position: Double; same code as egl_moveto
panel_7 = Panel(egl_moveto_5.Command)
egl_moveto_6 = CommandParameter(egl_moveto_5.Command)

# ----
entwine = Entwine(Branch00=egl_init_4, Branch01=egl_settings_3, FlattenInputs=True)  # -> flatten(Result)
egl_init_5 = CommandParameter(group_command_3)
egl_settings_4 = CommandParameter(group_command_4)
curve = Curve(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)
divide_curve = DivideCurve(Curve=curve, Count=10, Kinks=False)  # -> Points, Tangents, Parameters
list_length = ListLength(List=divide_curve.Points)  # -> expr("x/2", Length)

define_joints = DefineJoints(
    Axis1=Slider(0, range=-185..185),
    Axis2=Slider(-90, range=-190..45),
    Axis3=Slider(90, range=-120..158),
    Axis4=Slider(0, range=-350..350),
    Axis5=Slider(-90, range=-119..119),
    Axis6=Slider(0, range=-350..350),
    IsExt=False)
create_target = CreateTarget(Joints=define_joints, External="0", IsCartesian=False)

duplicate_data = DuplicateData(Data=egl_moveto_6, Number=list_length, Order=True)
vector_2pt = Vector2Pt(PointA=divide_curve.Points, PointB="0,0,0", Unitize=False)  # -> Vector, Length
xy_plane = XYPlane(Origin=divide_curve.Points)
explode_tree = ExplodeTree(Data=duplicate_data)  # -> Branch0, Branch1
list = RobotsLibrary(
    {"TUwien-KR10-2 (missing)": "TUwien-KR10-2", "Taiwan-IRB1600", "Taiwan-KR6", "Taiwan-KR10"}, selected="TUwien-KR10-2 (missing)",
    Type=0)
align_plane = AlignPlane(Plane=xy_plane, Direction=vector_2pt.Vector)  # -> Plane, Angle
weave = Weave(Pattern=[0, 1], Stream0=explode_tree.Branch0, Stream1=explode_tree.Branch1, NullGaps=False)
zone_parameter = ZoneParameter("0")
egl_settings_5 = CommandParameter(egl_settings_4)
create_target_2 = CreateTarget(Plane=align_plane.Plane, Zone=zone_parameter, Command=weave, External="0", IsCartesian=True)
egl_init_6 = CommandParameter(egl_init_5)
load_robot_system = LoadRobotSystem(Name=list, Base=PlaneXY(0, 0, 0))
entwine_2 = Entwine(Branch00=egl_init_6, Branch01=egl_settings_5, FlattenInputs=True)  # -> flatten(Result)
entwine_3 = Entwine(Branch00=create_target, Branch01=create_target_2, Branch02=create_target, FlattenInputs=True)  # -> flatten(Result)
robotsystem_parameter = RobotSystemParameter(load_robot_system)
create_program = CreateProgram(Name="EGL_FuncTests", RobotSystem=robotsystem_parameter, Targets=entwine_3, InitCommands=entwine_2, StepSize=1)  # -> Program, Code, Duration, Warnings, Errors
panel_8 = Panel(create_program.Errors)
program_simulation = ProgramSimulation(Program=create_program.Program, Time=Slider(1, range=0..1), Normalized=True)  # -> SystemMeshes, JointRotations, Plane, Index, Time, Program, Errors
explode_tree_2 = ExplodeTree(Data=create_program.Code)  # -> Branch0, Branch1, Branch2
panel_9 = Panel(explode_tree_2.Branch2)
panel_10 = Panel(explode_tree_2.Branch0)
panel_11 = Panel(explode_tree_2.Branch1)
