# Grasshopper definition Func_3DPrint_FakerBot.gh (Grasshopper 1.0.8)
# plug-ins: Human, Coco.GH1

feedrate_print = FeedratePrint(Slider(500, range=0..2000))  # Feedrate Print
temp_nozzle = TempNozzle(Slider(210, range=0..260))  # Temp. Nozzle
temp_bed = TempBed(Slider(80, range=0..100))  # Temp. Bed
filename = Filename("fkr_bot_setup")  # Filename of the file -> not the path, the name! Location will be the GH-documents location and .gcode is appended automatically.
points = Points()  # Points
save = Save(Button())  # Save

fakerbot = Panel("310,310,450")
box = Box2Pt(PointA="0,0,0", PointB=fakerbot, Plane=PlaneXY(0, 0, 0))
edges = BrepEdges(Brep=box)  # -> Naked, Interior, NonManifold
volume = Volume(Geometry=box)  # -> Volume, Centroid
pdecon = Deconstruct(Point=volume.Centroid)  # -> XComponent, YComponent, ZComponent
previewlw = CustomPreviewLineweights(Geometry=[edges.Naked, edges.Interior], Shader=edges.Interior, Thickness="3", Absolute=False)
pt = ConstructPoint(XCoordinate=pdecon.XComponent, YCoordinate=pdecon.YComponent, ZCoordinate="2")

point = Point(points)
bounding_box = BoundingBox(Content=flatten(point), Plane=PlaneXY(0, 0, 0), UnionBox=True)  # -> Box, Box_2
deconstruct_brep = DeconstructBrep(Brep=bounding_box.Box)  # -> Faces, Edges, Vertices
list_item = ListItem(List=deconstruct_brep.Faces, Index=0, Wrap=True)  # -> Item, Item1, Item2, Item3, Item4
area = Area(Geometry=list_item.Item4)  # -> Area, Centroid
vector_2pt = Vector2Pt(PointA=area.Centroid, PointB=pt, Unitize=False)  # -> Vector, Length
move = Move(Geometry=point, Motion=vector_2pt.Vector)  # -> Geometry, Transform
flatten = FlattenTree(Tree=move.Geometry, Path="{0}")
height = Panel("1.2")
width = Panel("3")
polyline = PolyLine(Vertices=flatten, Closed=False)
clean = CleanTree(RemoveNulls=True, RemoveInvalid=True, RemoveEmpty=False, Tree=flatten)
layer_width = LayerWidth(width)  # Layer Width
layer_height = LayerHeight(height)  # Layer Height
reldif = RelativeDifferences(Values=clean)
deconstruct = Deconstruct(Point=clean)  # -> XComponent, YComponent, ZComponent
vlen = VectorLength(Vector=reldif)
sort_list = SortList(Keys=deconstruct.ZComponent, ValuesValuesA=clean)  # -> Keys, ValuesValuesA
width_2 = Number(layer_width)
heights = Number(layer_height)
length = Number(vlen)
c_script = CSharpScript(Width=width_2, Height=heights, Length=length, Multiplier=Slider(0.1, range=0.001..2))  # -> out, Extrusion; inputs Width: Double, Height: Double, Length: Double, Multiplier: Double
# ---------- c_script: C# ----------
    var area = ((_Width - _Height) * _Height) + (Math.Pow((Math.PI * (_Height / 2)), 2));
    var volume = area * _Length;

    Extrusion_ = volume * _Multiplier;
# ---------- c_script: C# additional code ----------
  double FakerBotMultiplier = 0.1;
# ---------- end c_script ----------
item = ListItem(List=flatten(clean), Index=0, Wrap=True)  # -> Item1, Item
list_item_2 = ListItem(List=sort_list.ValuesValuesA, Index=0, Wrap=True)  # -> Item1, Item
list = ValueList({"G0": 0, "G1": 1, "G4": 2, "G21": 3, "G28": 4, "G29": 5, "M83": 6, "M84": 7, "G90": 8, "G92": 9, "M73": 10, "M104": 11, "M106": 12, "M107": 13, "M140": 14, "M201": 15, "M203": 16, "M205": 17}, selected="G1")
panel = Panel(c_script.Extrusion)

# ---- group: First Position 10mm above print POS
item_2 = ListItem(List=flatten(clean), Index=0, Wrap=True)
addition = Addition(A=item_2, B="{0,0,10}")
list_2 = ValueList({"G0": 0, "G1": 1, "G4": 2, "G21": 3, "G28": 4, "G29": 5, "M83": 6, "M84": 7, "G90": 8, "G92": 9, "M73": 10, "M104": 11, "M106": 12, "M107": 13, "M140": 14, "M201": 15, "M203": 16, "M205": 17}, selected="G1")
pt_to_g = PointToG(CommandType=list_2, Point=addition)

# ----
list_3 = ValueList({"X": 0, "Y": 1, "Z": 2, "E": 3, "F": 4, "K": 5, "J": 6, "I": 7, "C": 8, "B": 9, "A": 10, "P": 11, "R": 12, "S": 13, "H": 14}, selected="E")
num = Number(c_script.Extrusion)
list_4 = ValueList({"X": 0, "Y": 1, "Z": 2, "E": 3, "F": 4, "K": 5, "J": 6, "I": 7, "C": 8, "B": 9, "A": 10, "P": 11, "R": 12, "S": 13, "H": 14}, selected="E")

# ---- group: Load Filament for printing
list_5 = ValueList({"G0": 0, "G1": 1, "G4": 2, "G21": 3, "G28": 4, "G29": 5, "M83": 6, "M84": 7, "G90": 8, "G92": 9, "M73": 10, "M104": 11, "M106": 12, "M107": 13, "M140": 14, "M201": 15, "M203": 16, "M205": 17}, selected="G1")
comp_creategcommand = Comp_CreateGCommand(CommandType=list_5)
g_argument = CreateGArgument(Argument=list_4, Value=Slider(20, range=0..100))
add_argument = AddGArgument(Command=comp_creategcommand, Argument0=g_argument)

# ----
list_6 = ValueList({"X": 0, "Y": 1, "Z": 2, "E": 3, "F": 4, "K": 5, "J": 6, "I": 7, "C": 8, "B": 9, "A": 10, "P": 11, "R": 12, "S": 13, "H": 14}, selected="F")

# ---- group: Feedrate Travel
list_7 = ValueList({"G0": 0, "G1": 1, "G4": 2, "G21": 3, "G28": 4, "G29": 5, "M83": 6, "M84": 7, "G90": 8, "G92": 9, "M73": 10, "M104": 11, "M106": 12, "M107": 13, "M140": 14, "M201": 15, "M203": 16, "M205": 17}, selected="G1")
comp_creategcommand_2 = Comp_CreateGCommand(CommandType=list_7)
g_argument_2 = CreateGArgument(Argument=list_6, Value=Slider(1400, range=0..2000))
add_argument_2 = AddGArgument(Command=comp_creategcommand_2, Argument0=g_argument_2)

# ----
list_8 = ValueList({"X": 0, "Y": 1, "Z": 2, "E": 3, "F": 4, "K": 5, "J": 6, "I": 7, "C": 8, "B": 9, "A": 10, "P": 11, "R": 12, "S": 13, "H": 14}, selected="F")

# ---- group: Feedrate Print
list_9 = ValueList({"G0": 0, "G1": 1, "G4": 2, "G21": 3, "G28": 4, "G29": 5, "M83": 6, "M84": 7, "G90": 8, "G92": 9, "M73": 10, "M104": 11, "M106": 12, "M107": 13, "M140": 14, "M201": 15, "M203": 16, "M205": 17}, selected="G1")
comp_creategcommand_3 = Comp_CreateGCommand(CommandType=list_9)
g_argument_3 = CreateGArgument(Argument=list_8, Value=feedrate_print)
add_argument_3 = AddGArgument(Command=comp_creategcommand_3, Argument0=g_argument_3)

# ----
dots = DotDisplay(Point=item.Item1, Colour="red", Size="2")
dots_2 = DotDisplay(Point=item.Item, Colour="limegreen", Size="2")
pt_to_g_2 = PointToG(CommandType=list, Point=clean)  # -> simplify(Command)
g_argument_4 = CreateGArgument(Argument=list_3, Value=num)  # -> simplify(Argument)

pt_2 = Point(fakerbot)
parkextruder = CSharpScript(lastPos=list_item_2.Item1, maxPos=pt_2)  # -> out, Parking; inputs lastPos: Point3d, maxPos: Point3d
# ---------- parkextruder: C# ----------
    Parking_ = ParkExtruder(_lastPos, _maxPos);
# ---------- parkextruder: C# additional code ----------
  double feedrateTravel = 500;
  double retractDistance = 10; // negative extrusion before layer-change

  public List<string> ParkExtruder(Point3d lastPos, Point3d maxPos)
  {
    var commands = new List<string>
      {
        "; ---\n",
        "; PARKING_START\n",
        "G1 E" + -retractDistance * 2,
        "G0" + " F" + feedrateTravel,
        };

    if (lastPos.Z <= maxPos.Z - 50)
    {
      commands.Add(
        "G0" + " Z" + Math.Round(
        lastPos.Z + 50,
        3));
    }
    else
    {
      commands.Add(
        "G0" +
        " Z" + Math.Round(maxPos.Z, 3));
    }

    commands.Add(
      "G0" +
      " X" + Math.Round(50.0, 3) +
      " Y" + Math.Round(
      maxPos.Y - 50,
      3));

    commands.Add(
      "; PARKING_END\n"
      );

    return commands;
  }
# ---------- end parkextruder ----------

fakerbot_2 = CSharpScript(NozzleTemp=temp_nozzle, BedTemp=temp_bed)  # -> out, flatten(Header); inputs NozzleTemp: Double, BedTemp: Double
# ---------- fakerbot_2: C# ----------
    Header_ = HeaderFakerBot(_NozzleTemp, _BedTemp);
# ---------- fakerbot_2: C# additional code ----------
  public List<string> HeaderFakerBot(double nozzleTemp, double bedTemp)
  {
    return new List<string> {
        "; ---",
        "; HEADER_START",
        "M201 X1000 Y1000 Z1 E10000 ; sets maximum accelerations, mm / sec ^ 2" ,
        "M203 X150 Y150 Z3 E4000 ; sets maximum feedrates, mm / sec" ,
        "M204 P500 R1250 T1250 ; sets acceleration(P, T) and retract acceleration(R), mm / sec ^ 2" ,
        "M205 X8.00 Y8.00 Z0.40 E5.00 ; sets the jerk limits, mm/ sec" ,
        "M205 S0 T0 ; sets the minimum extruding and travel feed rate, mm/ sec" ,
        "M107 ; Fan off" ,
        ";",
        "G90 ; use absolute coordinates" ,
        "M83 ; extruder relative mode" ,
        "M140 S" + bedTemp + "; set final bed temp",
        "M104 S150 ; set temporary nozzle temp to prevent oozing during homing" ,
        "G4 S10 ; allow partial nozzle warmup" ,
        "G28 ; home all axis" ,
        "M104 S" + nozzleTemp + " ; set final nozzle temp" ,
        "G29 ; bed leveling" ,
        ";",
        "G1 Z50 F240" ,
        "G1 X2 Y10 F3000" ,
        //"M104 S" + nozzleTemp + " ; set final nozzle temp" ,
        "M190 S" + bedTemp + " ; wait for bed temp to stabilize" ,
        "M109 S" + nozzleTemp + " ; wait for nozzle temp to stabilize" ,
        "G1 Z1 F240" ,
        "G92 E0" ,
        ";",
        "G1 Y140 E50 F1500 ; prime the nozzle" ,
        "G1 X3 F5000" ,
        "G92 E0" ,
        "G1 Y10 E10 F1200 ; prime the nozzle" ,
        "G92 E0" ,
        "G21 ; set units to millimeters" ,
        "G90 ; use absolute coordinates" ,
        "M83 ; use relative distances for extrusion",
        ";",
        "M107 ; Fan off",
        "G92 E0",
        ";",
        "G1 Z10 F300",
        "G1 E-15 F600",
        "M106 P1 85S ; Set Nozzle Fan Third Speed",
        "; HEADER_END",
        };
  }
# ---------- end fakerbot_2 ----------
add_argument_4 = AddGArgument(Command=pt_to_g_2, Argument0=g_argument_4)

# ---- group: move down
item_3 = ListItem(List=flatten(pt_to_g_2), Index=0, Wrap=True)

# ----
footer = CSharpScript()  # -> out, Footer
# ---------- footer: C# ----------
   Footer_ =  new List<string>()
        {
          "; ---",
          "; FOOTER_START",
          "M140 S0 ; turn off heatbed",
          "M104 S0 ; turn off temperature",
          "M107 ; turn off fan",
          "M84 X Y E ; disable motors",
          "M73 P100 R0",
          "; FOOTER_END",
          };
# ---------- end footer ----------
entwine = Entwine(Branch00=pt_to_g, Branch01=item_3, Branch02=add_argument, FlattenInputs=True)  # -> flatten(Result)
entwine_2 = Entwine(Branch00=fakerbot_2.Header, Branch01=add_argument_2, FlattenInputs=True)  # -> flatten(Result)
entwine_3 = Entwine(Branch00=entwine_2, Branch01=entwine, FlattenInputs=True)  # -> flatten(Result)
entwine_4 = Entwine(Branch01=parkextruder.Parking, Branch02=footer.Footer, FlattenInputs=True)  # -> flatten(Result)
entwine_5 = Entwine(Branch00=entwine_3, Branch01=add_argument_3, Branch02=add_argument_4, Branch03=entwine_4, FlattenInputs=True)  # -> flatten(Result)

item_4 = ListItem(List=entwine_5, Index=0, Wrap=True)
c_script_2 = CSharpScript(x=item_4)  # -> A
# ---------- c_script_2: C# ----------
if(x!=null)
      A = true;
    else A = false;
# ---------- end c_script_2 ----------
file_properties = GHFileProperties(Refresh=c_script_2)  # -> DocumentID, Filepath, Filename, ProjectName
concat = Concatenate(FragmentA=file_properties.Filepath, FragmentB=filename, FragmentC=".gcode")
c_script_3 = CSharpScript(gcode=entwine_5, Filepath=concat, Write=save)  # -> out; inputs gcode: list of String, Filepath: String, Write: Boolean
# ---------- c_script_3: C# usings ----------
using System.IO;
# ---------- c_script_3: C# ----------
    if(_Write)
    {
      System.IO.File.WriteAllLines(_Filepath, _gcode);
    }
# ---------- end c_script_3 ----------

# ----
# M106 P1 S255 ; Set Nozzle Fan Full Speed
# M106 P6 S255 ; Set Chamber Fan Full Speed
panel_2 = Panel(entwine_5)
panel_3 = Panel(concat)
g_code = GCode(entwine_5)  # g-code
